% Simulink data dictionary Motor_Control_Data.sldd

Task_2ms = Simulink.Parameter(0.002)
Task_10ms = Simulink.Parameter(0.01)
Task_100us = Simulink.Parameter(0.0001)
Angle = Simulink.Parameter(1, StorageClass="Struct", StructName="CTL_Parameter", DataType="uint8")
Torque_Ref = Simulink.Parameter(5, StorageClass="Struct", StructName="CTL_Parameter", DataType="single")
Speed_target = Simulink.Signal()
Phase_CurrentABC = Simulink.Signal()
Angle_Theta = Simulink.Signal()
Bus_Voltage = Simulink.Signal()
Ta = Simulink.Signal()
Tb = Simulink.Signal()
Tc = Simulink.Signal()
Vq_voltage = Simulink.Signal(StorageClass="ExportedGlobal")
Iq_measured = Simulink.Signal(StorageClass="ExportedGlobal")
Id_measured = Simulink.Signal(StorageClass="ExportedGlobal")
V_beta = Simulink.Signal(StorageClass="ExportedGlobal")
V_alpha = Simulink.Signal(StorageClass="ExportedGlobal")
Vd_voltage = Simulink.Signal(StorageClass="ExportedGlobal")
Ibeta = Simulink.Signal(StorageClass="ExportedGlobal")
Ialpha = Simulink.Signal(StorageClass="ExportedGlobal")
Obser_Angle = Simulink.Signal(StorageClass="ExportedGlobal")
Obser_Speed = Simulink.Signal(StorageClass="ExportedGlobal")
Motor_Start_Stop = Simulink.Signal(StorageClass="ExportedGlobal")
Motor_Power = Simulink.Signal(StorageClass="ExportedGlobal")
Motor_Torque = Simulink.Signal(StorageClass="ExportedGlobal")
Speed_Ref = Simulink.Parameter(1000, StorageClass="Struct", StructName="CTL_Parameter", DataType="single")
Speed_Mesured = Simulink.Signal(StorageClass="ExportedGlobal")
Resolver_Speed = Simulink.Signal(StorageClass="ExportedGlobal")
Speed_RPM_Filtered = Simulink.Signal(StorageClass="ExportedGlobal")
Speed_Measured = Simulink.Signal()
Torque_ref = Simulink.Signal()
Id_ref = Simulink.Signal(StorageClass="ExportedGlobal")
Iq_ref = Simulink.Signal(StorageClass="ExportedGlobal")
Pole_Pairs = Simulink.Parameter(4)
MTPA_Te_Min = single(0)
Fixed_Step_Size = Simulink.Parameter(1.0e-5)
R = Simulink.Parameter(0.016)
Flux = Simulink.Parameter(0.1125)
Ld = Simulink.Parameter(0.00014)
Lq = Simulink.Parameter(0.0003115)
Cosine_table = Simulink.Parameter([1 0.99999529 0.99999058 0.99998587 0.99998116 0.99996704 0.99995291 0.99993885 0.99992472 0.99990118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 1], DataType="single")
Sine_table = Simulink.Parameter([0 0.0015339879 0.0030679768 0.0046019657 0.0061359555 0.0076698866 0.0092038177 0.010737749 0.012271681 0.013805497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 -0.001460568], DataType="single")
ID_Kp = Simulink.Parameter(0.84, StorageClass="Struct", StructName="PI_Parameter")
IQ_Kp = Simulink.Parameter(1.869, StorageClass="Struct", StructName="PI_Parameter")
ID_Ki = Simulink.Parameter(48, StorageClass="Struct", StructName="PI_Parameter")
IQ_Ki = Simulink.Parameter(48, StorageClass="Struct", StructName="PI_Parameter")
Speed_PI_OutputMax = Simulink.Parameter(700, StorageClass="Struct", StructName="PI_Parameter")
Speed_PI_OutputMin = Simulink.Parameter(-700, StorageClass="Struct", StructName="PI_Parameter")
Speed_Kp = Simulink.Parameter(0.08, StorageClass="Struct", StructName="PI_Parameter")
Speed_Ki = Simulink.Parameter(10.809, StorageClass="Struct", StructName="PI_Parameter")
TorqueMode = Simulink.Parameter(0, StorageClass="Struct", StructName="CTL_Parameter", DataType="uint8")
atan_table = Simulink.Parameter([-1.5690511 -1.5690503 -1.5690495 -1.5690485 -1.5690477 -1.5690469 -1.569046 -1.5690452 -1.5690442 -1.5690434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 1.5690511], DataType="single")
Dead_Time = Simulink.Parameter(2.5e-6, StorageClass="ExportedGlobal")
Dead_Com_Enable = Simulink.Parameter(1, StorageClass="ExportedGlobal", DataType="uint8")
Speed_Filter = Simulink.Signal(StorageClass="ExportedGlobal")
SpeedFilter_Fn = Simulink.Parameter(0.2, StorageClass="ExportedGlobal", DataType="single")
PWM_Frequency = Simulink.Parameter(10000)