% Simulink data dictionary G474_FOC_HF.sldd

PWMHalfPeriod = Simulink.Parameter(4199)  % 定时器中央对齐，PWM输出最大比较值
PWMHalfPeriod_MODEL = Simulink.Parameter(4199)
PolePairs_MODEL = Simulink.Parameter(5)  % 电机本体模型参数的设置，不支持定点数据。
PolePairs = Simulink.Parameter(5)
QPLL_Kp = Simulink.Parameter(20000)
QPLL_Ki = Simulink.Parameter(200000)
ObserverTheta = Simulink.Signal(StorageClass="Struct", StructName="ObserverParam")
Flux = Simulink.Parameter(0.0027)
Flux_MODEL = Simulink.Parameter(0.0027)  % 电机本体模型参数的设置，不支持定点数据。
Rs_MODEL = Simulink.Parameter(0.082)  % 电机本体模型参数的设置，不支持定点数据。
Rs = Simulink.Parameter(0.082)
Ld = Simulink.Parameter(4.9e-5)
Ld_MODEL = Simulink.Parameter(4.9e-5)
Lq = Simulink.Parameter(4.9e-5)
Lq_MODEL = Simulink.Parameter(4.9e-5)
MaxVoltage = Simulink.Parameter(5)
TsBSP_MODEL = Simulink.Parameter(2.0e-5)  % 模型采样时间等参数的设置，用来避免fixed point工具的更改导致无法仿真。
TsBSP = Simulink.Parameter(2.0e-5)  % 10kHz*4
TsFOC_MODEL = Simulink.Parameter(0.0001)  % 模型采样时间等参数的设置，用来避免fixed point工具的更改导致无法仿真。
TsFOC = Simulink.Parameter(0.0001)  % 10kHz
BandwidthCurrentPI = Simulink.Parameter(314.1593)  % 800*2*pi