% Simulink data dictionary Hall_HFI_FOC_Data.sldd

Task_2ms = Simulink.Parameter(0.002)
Task_10ms = Simulink.Parameter(0.01)
Task_100us = Simulink.Parameter(0.0001)
Angle = Simulink.Parameter(1, StorageClass="Struct", StructName="CTL_Parameter", DataType="uint8")
Torque_Ref = Simulink.Parameter(5, StorageClass="Struct", StructName="CTL_Parameter", DataType="single")
FluxWeak_Idref_max = Simulink.Parameter(0, StorageClass="Struct", StructName="FluxWeak_Parameter", DataType="single")
FluxWeak_Ismax = Simulink.Parameter(10, StorageClass="Struct", StructName="FluxWeak_Parameter", DataType="single")
MTPA_Te_Step = single(0.015)
Speed_target = Simulink.Signal()
Phase_CurrentABC = Simulink.Signal()
Angle_Theta = Simulink.Signal()
Bus_Voltage = Simulink.Signal()
SiC_Temperature = Simulink.Signal()
Motor_Temperature = Simulink.Signal()
VCU_Command = Simulink.Signal()
Resolver_signal = Simulink.Signal()
Angle_offset = Simulink.Parameter(0.1985, StorageClass="Struct", StructName="CTL_Parameter", DataType="single")
Ta = Simulink.Signal()
Tb = Simulink.Signal()
Tc = Simulink.Signal()
Vq_voltage = Simulink.Signal(StorageClass="ExportedGlobal")
Iq_measured = Simulink.Signal(StorageClass="ExportedGlobal")
Id_measured = Simulink.Signal(StorageClass="ExportedGlobal")
V_beta = Simulink.Signal(StorageClass="ExportedGlobal")
V_alpha = Simulink.Signal(StorageClass="ExportedGlobal")
Vd_voltage = Simulink.Signal(StorageClass="ExportedGlobal")
Ibeta = Simulink.Signal(StorageClass="ExportedGlobal")
Ialpha = Simulink.Signal(StorageClass="ExportedGlobal")
Obser_Angle = Simulink.Signal(StorageClass="ExportedGlobal")
Obser_Speed = Simulink.Signal(StorageClass="ExportedGlobal")
SYM_Current_State = Simulink.Signal(StorageClass="ExportedGlobal")
SYM_stDrvCtrl = Simulink.Signal(StorageClass="ExportedGlobal")
SYM_stGateDrv = Simulink.Signal(StorageClass="ExportedGlobal")
Motor_Start_Stop = Simulink.Signal(StorageClass="ExportedGlobal")
Motor_Power = Simulink.Signal(StorageClass="ExportedGlobal")
Motor_Torque = Simulink.Signal(StorageClass="ExportedGlobal")
Speed_Ref = Simulink.Parameter(1000, StorageClass="Struct", StructName="CTL_Parameter", DataType="single")
Speed_Mesured = Simulink.Signal(StorageClass="ExportedGlobal")
Resolver_Speed = Simulink.Signal(StorageClass="ExportedGlobal")
LADRC_Omega_c = Simulink.Parameter(80, StorageClass="ExportedGlobal")
LADRC_b0 = Simulink.Parameter(80000, StorageClass="ExportedGlobal")
Speed_RPM_Filtered = Simulink.Signal(StorageClass="ExportedGlobal")
Speed_Measured = Simulink.Signal()
Torque_ref = Simulink.Signal()
Id_ref = Simulink.Signal(StorageClass="ExportedGlobal")
Iq_ref = Simulink.Signal(StorageClass="ExportedGlobal")
MTPA_Te_Min = single(0)
MTPA_absIq_Max = Simulink.Parameter(705)
MTPA_id_table = Simulink.Parameter([0.22889 0.23462678 0.23770036 0.2381243 0.23591207 0.23107713 0.2236329 0.21359272 0.20096992 0.18577772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 -449.00659], DataType="single")
MTPA_iq_table = Simulink.Parameter([-1.0417 -0.16083497 0.71926296 1.5985928 2.4771533 3.3549435 4.2319627 5.1082091 5.9836826 6.8583813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 704.09711], DataType="single")
Cosine_table = Simulink.Parameter([1 0.99999529 0.99999058 0.99998587 0.99998116 0.99996704 0.99995291 0.99993885 0.99992472 0.99990118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 1], DataType="single")
Sine_table = Simulink.Parameter([0 0.0015339879 0.0030679768 0.0046019657 0.0061359555 0.0076698866 0.0092038177 0.010737749 0.012271681 0.013805497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 -0.001460568], DataType="single")
MTPA_Te_Max = single(800)
MTPA_absId_Max = Simulink.Parameter(1024)
atan_table = Simulink.Parameter([-1.5690511 -1.5690503 -1.5690495 -1.5690485 -1.5690477 -1.5690469 -1.569046 -1.5690452 -1.5690442 -1.5690434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 1.5690511], DataType="single")
Over_modulation = Simulink.Parameter(0, StorageClass="Struct", StructName="CTL_Parameter", DataType="boolean")
Speed_Filter = Simulink.Signal(StorageClass="ExportedGlobal")
HaLL_Timer_T = Simulink.Parameter(1.0e-5, StorageClass="Struct", StructName="Hall_Parameter", DataType="single")
HaLL_Sector1 = Simulink.Parameter(5.236, StorageClass="Struct", StructName="Hall_Parameter", DataType="single")
HaLL_Sector2 = Simulink.Parameter(1.0472, StorageClass="Struct", StructName="Hall_Parameter", DataType="single")
HaLL_Sector3 = Simulink.Parameter(0, StorageClass="Struct", StructName="Hall_Parameter", DataType="single")
HaLL_Sector4 = Simulink.Parameter(3.1415, StorageClass="Struct", StructName="Hall_Parameter", DataType="single")
HaLL_Sector5 = Simulink.Parameter(4.1888, StorageClass="Struct", StructName="Hall_Parameter", DataType="single")
HaLL_Sector6 = Simulink.Parameter(2.0944, StorageClass="Struct", StructName="Hall_Parameter", DataType="single")
HaLL_AngleShift = Simulink.Parameter(-0.25, StorageClass="Struct", StructName="Hall_Parameter", DataType="single")
Pole_Pairs = Simulink.Parameter(2)
FF_Enable = Simulink.Parameter(0, StorageClass="ExportedGlobal", DataType="uint8")
MTPA_Enable = Simulink.Parameter(0, StorageClass="ExportedGlobal", DataType="uint8")
Dead_Com_Enable = Simulink.Parameter(0, StorageClass="ExportedGlobal", DataType="uint8")
PWM_Frequency = Simulink.Parameter(10000)
Dead_Time = Simulink.Parameter(0, StorageClass="ExportedGlobal")
SpeedFilter_Fn = Simulink.Parameter(0.3, StorageClass="ExportedGlobal", DataType="single")
ObserverTheta = Simulink.Signal()
SMO_PLL_W = Simulink.Parameter(50, StorageClass="Struct", StructName="SMO_Parameter", DataType="single")
Hall_Angle = Simulink.Signal(StorageClass="ExportedGlobal", DataType="single")
Hall_Speed = Simulink.Signal(StorageClass="ExportedGlobal")
Obs_Theta = Simulink.Signal(StorageClass="ExportedGlobal")
Obs_Speed = Simulink.Signal(StorageClass="ExportedGlobal")
ObserverOmega = Simulink.Signal(StorageClass="ExportedGlobal")
Flux_Theta_Enable = Simulink.Parameter(0, StorageClass="Struct", StructName="Flux_Parameter", DataType="uint8")
Flux_Gain = Simulink.Parameter(1, StorageClass="Struct", StructName="Flux_Parameter", DataType="single")
R = Simulink.Parameter(0.405)
Speed_PI_OutputMax = Simulink.Parameter(6, StorageClass="Struct", StructName="PI_Parameter")
Speed_PI_OutputMin = Simulink.Parameter(-6, StorageClass="Struct", StructName="PI_Parameter")
Ld = Simulink.Parameter(0.0004)
Lq = Simulink.Parameter(0.00045)
Flux = Simulink.Parameter(0.00529276)
Fixed_Step_Size = Simulink.Parameter(2.5e-5)
ID_Kp = Simulink.Parameter(0.4, StorageClass="Struct", StructName="PI_Parameter")
IQ_Kp = Simulink.Parameter(0.45, StorageClass="Struct", StructName="PI_Parameter")
SMO_K = Simulink.Parameter(0.2, StorageClass="Struct", StructName="SMO_Parameter", DataType="single")
SMO_M = Simulink.Parameter(0.1, StorageClass="Struct", StructName="SMO_Parameter", DataType="single")
Speed_Kp = Simulink.Parameter(0.00867, StorageClass="Struct", StructName="PI_Parameter")
Speed_Ki = Simulink.Parameter(0.0633, StorageClass="Struct", StructName="PI_Parameter")
ID_Ki = Simulink.Parameter(45, StorageClass="Struct", StructName="PI_Parameter")
IQ_Ki = Simulink.Parameter(45, StorageClass="Struct", StructName="PI_Parameter")
HFI_Fuc_Enalbe = Simulink.Parameter(1, StorageClass="Struct", StructName="HFI_Parameter", DataType="uint8")
SMO_Theta_Enable = Simulink.Parameter(0, StorageClass="Struct", StructName="SMO_Parameter", DataType="uint8")
HFI_PLL_Xi = Simulink.Parameter(0.707, StorageClass="Struct", StructName="HFI_Parameter", DataType="single")
HFI_Inj_HV = Simulink.Parameter(2, StorageClass="Struct", StructName="HFI_Parameter", DataType="single")
HFI_Inj_HF = Simulink.Parameter(1000, StorageClass="Struct", StructName="HFI_Parameter", DataType="single")
HFI_IPD_V = Simulink.Parameter(1, StorageClass="Struct", StructName="HFI_Parameter", DataType="single")
HFI_IPD_F = Simulink.Parameter(1000, StorageClass="Struct", StructName="HFI_Parameter", DataType="single")
HFI_IPD_Time = Simulink.Parameter(0.1, StorageClass="Struct", StructName="HFI_Parameter", DataType="single")
HFI_NS_V = Simulink.Parameter(1, StorageClass="Struct", StructName="HFI_Parameter", DataType="single")
HFI_NS_Time = Simulink.Parameter(0.05, StorageClass="Struct", StructName="HFI_Parameter", DataType="single")
HFI_Pulse_Time = Simulink.Parameter(0.001, StorageClass="Struct", StructName="HFI_Parameter", DataType="single")
HFI_Low_Time = Simulink.Parameter(0.01, StorageClass="Struct", StructName="HFI_Parameter", DataType="single")
HFI_Switch_Time = Simulink.Parameter(0.1, StorageClass="Struct", StructName="HFI_Parameter", DataType="single")
HFI_NS2RUN_Time = Simulink.Parameter(0.1, StorageClass="Struct", StructName="HFI_Parameter", DataType="single")
HFI_We = Simulink.Parameter(6283, StorageClass="Struct", StructName="HFI_Parameter", DataType="single")
HFI_bw_BPF = Simulink.Parameter(100, StorageClass="Struct", StructName="HFI_Parameter", DataType="single")
HFI_NS_Low_Time = Simulink.Parameter(0.01, StorageClass="Struct", StructName="HFI_Parameter", DataType="single")
HFI_PLL_Omga = Simulink.Parameter(50, StorageClass="Struct", StructName="HFI_Parameter", DataType="single")
Id2 = Simulink.Signal(StorageClass="ExportedGlobal")
Id1 = Simulink.Signal(StorageClass="ExportedGlobal")
HFI_PLL_Out = Simulink.Signal(StorageClass="ExportedGlobal")
Initial_Theta = Simulink.Signal(StorageClass="ExportedGlobal")
NS_Theta = Simulink.Signal(StorageClass="ExportedGlobal")
Ia_RMS = Simulink.Signal(StorageClass="ExportedGlobal")
Ib_RMS = Simulink.Signal(StorageClass="ExportedGlobal")
Ic_RMS = Simulink.Signal(StorageClass="ExportedGlobal")
TorqueMode = Simulink.Parameter(1, StorageClass="Struct", StructName="CTL_Parameter", DataType="uint8")