% Simulink data dictionary G474_FOC_HSMO.sldd

PWMHalfPeriod = Simulink.Parameter(4199)  % 定时器中央对齐，PWM输出最大比较值
PWMHalfPeriod_MODEL = Simulink.Parameter(4199)
PolePairs_MODEL = Simulink.Parameter(5)  % 电机本体模型参数的设置，不支持定点数据。
PolePairs = Simulink.Parameter(5)
MaxVoltage = Simulink.Parameter(10)
TsBSP = Simulink.Parameter(5.0e-6)  % 10kHz*4
TsBSP_MODEL = Simulink.Parameter(5.0e-6)  % 模型采样时间等参数的设置，用来避免fixed point工具的更改导致无法仿真。
QPLL_Kp = Simulink.Parameter(25)
QPLL_Ki = Simulink.Parameter(6000)
Rs_MODEL = Simulink.Parameter(0.1763)  % 电机本体模型参数的设置，不支持定点数据。
Flux_MODEL = Simulink.Parameter(0.0109)  % 电机本体模型参数的设置，不支持定点数据。
BandwidthCurrentPI = Simulink.Parameter(1256.637)  % 800*2*pi
Ld = Simulink.Parameter(0.000195185)
Lq = Simulink.Parameter(0.000195185)
Ld_MODEL = Simulink.Parameter(0.000195185)
Lq_MODEL = Simulink.Parameter(0.000195185)
TsFOC = Simulink.Parameter(0.0001)  % 10kHz
TsFOC_MODEL = Simulink.Parameter(0.0001)  % 模型采样时间等参数的设置，用来避免fixed point工具的更改导致无法仿真。
Rs = Simulink.Parameter(0.1764)
Flux = Simulink.Parameter(0.0109)
ObserverTheta = Simulink.Signal(StorageClass="Struct", StructName="ObserverParam")
GainK = Simulink.Parameter(2)
GainM = Simulink.Parameter(0.15)